# Grasshopper definition triangleClosestPoint.gh (Grasshopper 1.0.7)

P = Point(<point referenced from the Rhino model>)
vec = Vector(P)
p3 = Point(<point referenced from the Rhino model>)
p2 = Point(<point referenced from the Rhino model>)
p1 = Point(<point referenced from the Rhino model>)
srf4pt = _4PointSurface(CornerA=p1, CornerB=p2, CornerC=p3)
subtraction = Subtraction(A=p1, B=p2)
subtraction_2 = Subtraction(A=p3, B=p1)
subtraction_3 = Subtraction(A=p2, B=p3)
vec_2 = Vector(p2)
vec_3 = Vector(p1)
vec_4 = Vector(p3)
panel = Panel([vec, vec_3, vec_2, vec_4])
vlen = VectorLength(Vector=subtraction)
vlen_2 = VectorLength(Vector=subtraction_2)
vlen_3 = VectorLength(Vector=subtraction_3)
subtraction_4 = Subtraction(A=P, B=p1)
division = Division(A=subtraction_2, B=vlen_2)
subtraction_5 = Subtraction(A=p2, B=p1)
subtraction_6 = Subtraction(A=p3, B=p1)
panel_2 = Panel([subtraction_5, subtraction_6])
division_2 = Division(A=subtraction, B=vlen)
division_3 = Division(A=subtraction_3, B=vlen_3)
panel_3 = Panel(subtraction_4)
xprod = CrossProduct(VectorA=subtraction_5, VectorB=subtraction_6, Unitize=True)  # -> Vector, Length
panel_4 = Panel(xprod.Vector)
dprod = DotProduct(VectorA=subtraction_4, VectorB=xprod.Vector, Unitize=False)
rot3d = Rotate3D(Geometry=division, Angle=1.570796327, Center=Point(0, 0, 0), Axis=xprod.Vector)  # -> R3_N_PERP, Transform
rot3d_2 = Rotate3D(Geometry=division_3, Angle=1.570796327, Center=Point(0, 0, 0), Axis=xprod.Vector)  # -> R2_N_PERP, Transform
rot3d_3 = Rotate3D(Geometry=division_2, Angle=1.570796327, Center=Point(0, 0, 0), Axis=xprod.Vector)  # -> R1_N_PERP, Transform
neg = Negative(Value=xprod.Vector)
panel_5 = Panel(dprod)
multiplication = Multiplication(A=dprod, B=neg)
addition = Addition(A=P, B=multiplication)
subtraction_7 = Subtraction(A=addition, B=p1)
subtraction_8 = Subtraction(A=addition, B=p2)
subtraction_9 = Subtraction(A=addition, B=p3)

xprod_2 = CrossProduct(VectorA=subtraction_7, VectorB=division_2, Unitize=False)  # -> Vector, Length
xprod_3 = CrossProduct(VectorA=subtraction_8, VectorB=division_3, Unitize=False)  # -> Vector, Length
xprod_4 = CrossProduct(VectorA=subtraction_9, VectorB=division, Unitize=False)  # -> Vector, Length
dprod_2 = DotProduct(VectorA=xprod_4.Vector, VectorB=xprod.Vector, Unitize=False)
dprod_3 = DotProduct(VectorA=xprod_2.Vector, VectorB=xprod.Vector, Unitize=False)
dprod_4 = DotProduct(VectorA=xprod_3.Vector, VectorB=xprod.Vector, Unitize=False)
panel_6 = Panel([dprod_3, dprod_4, dprod_2])

pl_3pt = Plane3Pt(PointA=P, PointB=addition, PointC=p1)
pl_3pt_2 = Plane3Pt(PointA=P, PointB=addition, PointC=p2)
pl_3pt_3 = Plane3Pt(PointA=P, PointB=addition, PointC=p3)
dprod_5 = DotProduct(VectorA=subtraction_7, VectorB=division, Unitize=False)
dprod_6 = DotProduct(VectorA=subtraction_8, VectorB=division_2, Unitize=False)
dprod_7 = DotProduct(VectorA=subtraction_9, VectorB=division_3, Unitize=False)
panel_7 = Panel([dprod_5, dprod_6, dprod_7])
dprod_8 = DotProduct(VectorA=subtraction_7, VectorB=rot3d.R3_N_PERP, Unitize=False)
dprod_9 = DotProduct(VectorA=subtraction_8, VectorB=rot3d_3.R1_N_PERP, Unitize=False)
dprod_10 = DotProduct(VectorA=subtraction_9, VectorB=rot3d_2.R2_N_PERP, Unitize=False)
subtraction_10 = Subtraction(A=vlen_3, B=dprod_7)
subtraction_11 = Subtraction(A=vlen, B=dprod_6)
subtraction_12 = Subtraction(A=vlen_2, B=dprod_5)
multiplication_2 = Multiplication(A=dprod_8, B=rot3d.R3_N_PERP)
multiplication_3 = Multiplication(A=dprod_9, B=rot3d_3.R1_N_PERP)
multiplication_4 = Multiplication(A=dprod_10, B=rot3d_2.R2_N_PERP)
panel_8 = Panel(addition)
panel_9 = Panel(subtraction_11)
panel_10 = Panel(subtraction_10)
panel_11 = Panel(subtraction_12)
neg_2 = Negative(Value=multiplication_4)
neg_3 = Negative(Value=multiplication_2)
neg_4 = Negative(Value=multiplication_3)
c_script = CSharpScript(p=addition, a=p1, b=p2, c=p3)  # -> out, A, B, C; inputs p: Point3d, a: Point3d, b: Point3d, c: Point3d
# ---------- c_script: C# ----------
    Vector3d v0 = b - a, v1 = c - a, v2 = p - a;
    double d00 = v0 * v0;
    double d01 = v0 * v1;
    double d11 = v1 * v1;
    double d20 = v2 * v0;
    double d21 = v2 * v1;
    double denom = d00 * d11 - d01 * d01;
    double u,v,w;
    v = (d11 * d20 - d01 * d21) / denom;
    w = (d00 * d21 - d01 * d20) / denom;
    u = 1.0 - v - w;
    A = new double[3]{u, v, w};
    B = denom;
# ---------- end c_script ----------
correctiondist = CSharpScript(x=panel_9, y=dprod_6)  # -> out, A; inputs x: Double, y: Double
# ---------- correctiondist: C# ----------
    if(y <= 0.0)
    {
      A = -y;
    }
    else if(x <= 0)
      A = x;
    else
      A = 0;
# ---------- end correctiondist ----------
correctiondist_2 = CSharpScript(x=panel_10, y=dprod_7)  # -> out, A; inputs x: Double, y: Double; same code as correctiondist
correctiondist_3 = CSharpScript(x=panel_11, y=dprod_5)  # -> out, A; inputs x: Double, y: Double; same code as correctiondist
flatten = FlattenTree(Tree=c_script.A, Path="{0}")
move = Move(Geometry=addition, Motion=neg_3)  # -> P_Prime_C1, Transform
move_2 = Move(Geometry=addition, Motion=neg_2)  # -> P_Prime_C3, Transform
move_3 = Move(Geometry=addition, Motion=neg_4)  # -> P_Prime_C2, Transform
panel_12 = Panel(correctiondist_2.A)
panel_13 = Panel(correctiondist.A)
panel_14 = Panel(correctiondist_3.A)
item = ListItem(List=flatten, Index=0, Wrap=True)
item_2 = ListItem(List=flatten, Index=1, Wrap=True)
item_3 = ListItem(List=flatten, Index=2, Wrap=True)
multiplication_5 = Multiplication(A=division_3, B=panel_12)
bcentric = Barycentric(PointA=p1, PointB=p2, PointC=p3, CoordinateU=item, CoordinateV=item_2, CoordinateW=item_3)
multiplication_6 = Multiplication(A=division, B=panel_14)
panel_15 = Panel([item, item_2, item_3])
multiplication_7 = Multiplication(A=division_2, B=panel_13)
addition_2 = Addition(A=move.P_Prime_C1, B=multiplication_6)
addition_3 = Addition(A=move_2.P_Prime_C3, B=multiplication_5)
addition_4 = Addition(A=move_3.P_Prime_C2, B=multiplication_7)
relay = Relay([addition_2, addition_4, addition_3])

subtraction_13 = Subtraction(A=relay, B=addition)
vlen_4 = VectorLength(Vector=subtraction_13)
sort = SortList(Keys=vlen_4, ValuesA=relay)  # -> Keys, ValuesA
item_4 = ListItem(List=sort.ValuesA, Index=0, Wrap=True)

c_script_2 = CSharpScript(x=item, y=item_2, z=item_3, u=addition, v=item_4)  # -> out, A; inputs x: Double, y: Double, z: Double, u: Point3d, v: Point3d
# ---------- c_script_2: C# ----------
    if(x < 0.0 || x > 1)
    {
      A = v;
      return;
    }    
    if(y < 0.0 || y > 1)
    {
      A = v;
      return;
    }
    if(z < 0.0 || z > 1)
    {
      A = v;
      return;
    }
    A = u;
# ---------- end c_script_2 ----------
panel_16 = Panel(c_script_2.A)
